# Dynamo graph Label Intersecting 3DPolylines.dyn "Utility-xings" (Dynamo 2.15.1.6076)

# group: Select Polyline and project in onto x,y plane (0,0,0)
select_object = ObjectSelection()  # 1 picked in the model
geometry = Autodesk.AutoCAD.DynamoNodes.Object.Geometry(object=select_object)
byOriginNormal = Plane.ByOriginNormal()
code_block = CodeBlock { -1; }
byCoordinates = Vector.ByCoordinates(z=code_block)
project = Curve.Project(curve=geometry, baseGeometry=byOriginNormal, projectionDirection=byCoordinates)

# group: Select Polyline and project it onto x,y plane (0,0,0)
select_object_2 = ObjectSelection()  # 1 picked in the model
geometry_2 = Autodesk.AutoCAD.DynamoNodes.Object.Geometry(object=select_object_2)
byOriginNormal_2 = Plane.ByOriginNormal()
code_block_2 = CodeBlock { -1; }
byCoordinates_2 = Vector.ByCoordinates(z=code_block_2)
project_2 = Curve.Project(curve=geometry_2, baseGeometry=byOriginNormal_2, projectionDirection=byCoordinates_2)

# group: Identify Crossings
intersect = Geometry.Intersect(geometry=project, other=project_2)

# group: Dynamo -> Civil3D
current = Autodesk.AutoCAD.DynamoNodes.Document.Current()
modelSpace = Autodesk.AutoCAD.DynamoNodes.Document.ModelSpace(document=current)

# group: Circle Crossing Points
code_block_3 = CodeBlock { 4; }
byCenterPointRadius = Circle.ByCenterPointRadius(centerPoint=intersect, radius=code_block_3)
code_block_4 = CodeBlock { "UTIL-XING"; }
byGeometry = Autodesk.AutoCAD.DynamoNodes.Object.ByGeometry(geometry=byCenterPointRadius, layer=code_block_4, block=modelSpace)

# group: Text
code_block_5 = CodeBlock { "UTILITY CROSSING"; 0.5; }
MTextHorizontalAttachment = HorizontalAttachment("Center")
MTextVerticalAttachment = VerticalAttachment("Bottom")
create = Autodesk.AutoCAD.DynamoNodes.Text.Create(text=code_block_5.out0, insertionPoint=intersect, height=code_block_5.out1, horizontalMode=MTextHorizontalAttachment, verticalMode=MTextVerticalAttachment, layer=code_block_4, block=modelSpace)

startPoint = Curve.StartPoint()  # unwired: curve
endPoint = Curve.EndPoint()  # unwired: curve
byStartPointEndPoint = Line.ByStartPointEndPoint(startPoint=startPoint, endPoint=endPoint)
